vi "Main.gviweb"   [LabVIEW NXG 2.0.0]
panel controls:
  "Previous test Results": i32 = -1
  "Select Test Site": i32 = "NIWeek Keynote Stage"(0)
panel indicators:
  "Observed Data and Fitted Curve": cluster{"Element 1": f64, "Element 2": f64}[][]
  "Sequence Pass/Fail": bool
  "Test Sequence Results": T1[]
types:
  T1 = cluster{"Bandwidth (MHz)": f64, "SNR": f64, "Power Consumption %": f64, "Step Pass?": bool}
uses:
  Application::Get Tag.gviweb
diagram:
  w1 = [FALSE, FALSE, FALSE, FALSE, FALSE, FALSE, FALSE, FALSE, FALSE, FALSE, FALSE]
  s1 = w1  # shift register
  s2 = T1[] []  # shift register
  while (iteration -> i1) {
    Wait(time to wait=250)
    call "Get Tag.gviweb"(Host="cirrostratus") -> (Array=w2, Array_2=w3, Observed Data and Fitted Curve=w4)
    call "Aggregate Test Data.gviweb"(Array=s1, Array_3=s2, Array_5=w2, Array_2=w3, Numeric=i1) -> (Array_4=w5, Sequence Pass/Fail=w6, Test Sequence Results=w7)
    $"Sequence Pass/Fail" <- w6
    $"Test Sequence Results" <- w7
    $"Observed Data and Fitted Curve" <- w4
    next s1 = w5
    next s2 = w7
    stop if FALSE
  }
